# Grasshopper definition DivaSimulation.gh (Grasshopper 1.0.7)
# plug-ins: DIVA Daylight

# Importing Geometry
file = ReadFile(File="C:\Users\iicpe\Desktop\KhepriNotebook\Facade_Tiling_Optimization\scripts\start.txt", PerLineParse=True)

# ----
# Dynamic Elements
pipeline = GeometryPipeline(
    GroupByLayer=False,
    GroupByType=False,
    IncludeHidden=True,
    IncludeLocked=True,
    LayerFilter="Facade_Tiles*",
    NameFilter="*",
    SublayerFiltering=True,
    TypeFilter=1073741848)

# ----
# Static Elements
pipeline_2 = GeometryPipeline(
    GroupByLayer=False,
    GroupByType=False,
    IncludeHidden=True,
    IncludeLocked=True,
    LayerFilter="Outside_Envelope",
    NameFilter="*",
    SublayerFiltering=True,
    TypeFilter=1073741848)
pipeline_3 = GeometryPipeline(
    GroupByLayer=False,
    GroupByType=False,
    IncludeHidden=True,
    IncludeLocked=True,
    LayerFilter="Ceiling",
    NameFilter="*",
    SublayerFiltering=True,
    TypeFilter=1073741848)
pipeline_4 = GeometryPipeline(
    GroupByLayer=False,
    GroupByType=False,
    IncludeHidden=True,
    IncludeLocked=True,
    LayerFilter="Floor",
    NameFilter="*",
    SublayerFiltering=True,
    TypeFilter=1073741848)
pipeline_5 = GeometryPipeline(
    GroupByLayer=False,
    GroupByType=False,
    IncludeHidden=True,
    IncludeLocked=True,
    LayerFilter="Floors",
    NameFilter="*",
    SublayerFiltering=True,
    TypeFilter=1073741848)
pipeline_6 = GeometryPipeline(
    GroupByLayer=False,
    GroupByType=False,
    IncludeHidden=True,
    IncludeLocked=True,
    LayerFilter="InteriorWall",
    NameFilter="*",
    SublayerFiltering=True,
    TypeFilter=1073741848)
pipeline_7 = GeometryPipeline(
    GroupByLayer=False,
    GroupByType=False,
    IncludeHidden=True,
    IncludeLocked=True,
    LayerFilter="WindowGlass",
    NameFilter="*",
    SublayerFiltering=True,
    TypeFilter=1073741848)
pipeline_8 = GeometryPipeline(
    GroupByLayer=False,
    GroupByType=False,
    IncludeHidden=True,
    IncludeLocked=True,
    LayerFilter="Surrodings",
    NameFilter="*",
    SublayerFiltering=True,
    TypeFilter=1073741848)

pipeline_9 = GeometryPipeline(
    GroupByLayer=False,
    GroupByType=False,
    IncludeHidden=True,
    IncludeLocked=True,
    LayerFilter="OutsideFloor",
    NameFilter="*",
    SublayerFiltering=True,
    TypeFilter=1073741848)
jagged = SettingsSpeed()
mesh = MeshBrep(Brep=pipeline, Settings=jagged)

# ----
# Generating Analysis Nodes
Z = UnitZ(Factor=0.8)
move = Move(Geometry=pipeline_4, Motion=Z)  # -> Geometry, Transform
grid = DaylightingGrid(
    Geometry=move.Geometry,
    Spacing=Slider(0.6, range=0..1),
    BooleanValue_0=False,
    BooleanValue_1=False,
    BooleanValue_10=False,
    BooleanValue_11=False,
    BooleanValue_12=False,
    BooleanValue_13=False,
    BooleanValue_14=False,
    BooleanValue_15=False,
    BooleanValue_16=False,
    BooleanValue_17=False,
    BooleanValue_18=False,
    BooleanValue_19=False,
    BooleanValue_2=False,
    BooleanValue_20=False,
    BooleanValue_21=False,
    BooleanValue_22=False,
    BooleanValue_3=False,
    BooleanValue_4=False,
    BooleanValue_5=False,
    BooleanValue_6=False,
    BooleanValue_7=False,
    BooleanValue_8=False,
    BooleanValue_9=False,
    Color_0=RGBA(0, 0, 0, 0),
    Color_1=RGBA(0, 0, 0, 0),
    Color_10=RGBA(0, 0, 0, 0),
    Color_11=RGBA(0, 0, 0, 0),
    Color_12=RGBA(0, 0, 0, 0),
    Color_13=RGBA(0, 0, 0, 0),
    Color_14=RGBA(0, 0, 0, 0)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)

# ----
# Assigning Materials
obj = SceneObject(
    Geometry=mesh,
    BooleanValue_0=False,
    BooleanValue_1=False,
    Color_0=RGBA(0, 0, 0, 0),
    Color_1=RGBA(0, 0, 0, 0),
    Hidden_0=False,
    Hidden_1=False,
    IntegerValue_0=-2147483648,
    IntegerValue_1=-2147483648,
    IntervalMax_0=-1.797693135e+308,
    IntervalMax_1=-1.797693135e+308,
    IntervalMin_0=-1.797693135e+308,
    IntervalMin_1=-1.797693135e+308,
    Name_0="Geometry",
    Name_1="Material",
    NumberValue_0=-1.797693135e+308,
    NumberValue_1=-1.797693135e+308,
    OutputHidden_0=False,
    OutputName_0="Scene Object",
    TextValuePersistent_1="GenericCeiling_80",
    TextValueVolatile_1="GenericCeiling_80")
obj_2 = SceneObject(
    Geometry=[pipeline_5, pipeline_4],
    BooleanValue_0=False,
    BooleanValue_1=False,
    Color_0=RGBA(0, 0, 0, 0),
    Color_1=RGBA(0, 0, 0, 0),
    Hidden_0=False,
    Hidden_1=False,
    IntegerValue_0=-2147483648,
    IntegerValue_1=-2147483648,
    IntervalMax_0=-1.797693135e+308,
    IntervalMax_1=-1.797693135e+308,
    IntervalMin_0=-1.797693135e+308,
    IntervalMin_1=-1.797693135e+308,
    Name_0="Geometry",
    Name_1="Material",
    NumberValue_0=-1.797693135e+308,
    NumberValue_1=-1.797693135e+308,
    OutputHidden_0=False,
    OutputName_0="Scene Object",
    TextValuePersistent_1="TileFloor_40",
    TextValueVolatile_1="TileFloor_40")
obj_3 = SceneObject(
    Geometry=pipeline_2,
    BooleanValue_0=False,
    BooleanValue_1=False,
    Color_0=RGBA(0, 0, 0, 0),
    Color_1=RGBA(0, 0, 0, 0),
    Hidden_0=False,
    Hidden_1=False,
    IntegerValue_0=-2147483648,
    IntegerValue_1=-2147483648,
    IntervalMax_0=-1.797693135e+308,
    IntervalMax_1=-1.797693135e+308,
    IntervalMin_0=-1.797693135e+308,
    IntervalMin_1=-1.797693135e+308,
    Name_0="Geometry",
    Name_1="Material",
    NumberValue_0=-1.797693135e+308,
    NumberValue_1=-1.797693135e+308,
    OutputHidden_0=False,
    OutputName_0="Scene Object",
    TextValuePersistent_1="OutsideFacade_35",
    TextValueVolatile_1="OutsideFacade_35")
obj_4 = SceneObject(
    Geometry=pipeline_3,
    BooleanValue_0=False,
    BooleanValue_1=False,
    Color_0=RGBA(0, 0, 0, 0),
    Color_1=RGBA(0, 0, 0, 0),
    Hidden_0=False,
    Hidden_1=False,
    IntegerValue_0=-2147483648,
    IntegerValue_1=-2147483648,
    IntervalMax_0=-1.797693135e+308,
    IntervalMax_1=-1.797693135e+308,
    IntervalMin_0=-1.797693135e+308,
    IntervalMin_1=-1.797693135e+308,
    Name_0="Geometry",
    Name_1="Material",
    NumberValue_0=-1.797693135e+308,
    NumberValue_1=-1.797693135e+308,
    OutputHidden_0=False,
    OutputName_0="Scene Object",
    TextValuePersistent_1="GenericCeiling_80",
    TextValueVolatile_1="GenericCeiling_80")
obj_5 = SceneObject(
    Geometry=pipeline_6,
    BooleanValue_0=False,
    BooleanValue_1=False,
    Color_0=RGBA(0, 0, 0, 0),
    Color_1=RGBA(0, 0, 0, 0),
    Hidden_0=False,
    Hidden_1=False,
    IntegerValue_0=-2147483648,
    IntegerValue_1=-2147483648,
    IntervalMax_0=-1.797693135e+308,
    IntervalMax_1=-1.797693135e+308,
    IntervalMin_0=-1.797693135e+308,
    IntervalMin_1=-1.797693135e+308,
    Name_0="Geometry",
    Name_1="Material",
    NumberValue_0=-1.797693135e+308,
    NumberValue_1=-1.797693135e+308,
    OutputHidden_0=False,
    OutputName_0="Scene Object",
    TextValuePersistent_1="WhiteInteriorWall_70",
    TextValueVolatile_1="WhiteInteriorWall_70")
obj_6 = SceneObject(
    Geometry=pipeline_7,
    BooleanValue_0=False,
    BooleanValue_1=False,
    Color_0=RGBA(0, 0, 0, 0),
    Color_1=RGBA(0, 0, 0, 0),
    Hidden_0=False,
    Hidden_1=False,
    IntegerValue_0=-2147483648,
    IntegerValue_1=-2147483648,
    IntervalMax_0=-1.797693135e+308,
    IntervalMax_1=-1.797693135e+308,
    IntervalMin_0=-1.797693135e+308,
    IntervalMin_1=-1.797693135e+308,
    Name_0="Geometry",
    Name_1="Material",
    NumberValue_0=-1.797693135e+308,
    NumberValue_1=-1.797693135e+308,
    OutputHidden_0=False,
    OutputName_0="Scene Object",
    TextValuePersistent_1="Glazing_DoublePane_LowE_65",
    TextValueVolatile_1="Glazing_DoublePane_LowE_65")
obj_7 = SceneObject(
    Geometry=pipeline_8,
    BooleanValue_0=False,
    BooleanValue_1=False,
    Color_0=RGBA(0, 0, 0, 0),
    Color_1=RGBA(0, 0, 0, 0),
    Hidden_0=False,
    Hidden_1=False,
    IntegerValue_0=-2147483648,
    IntegerValue_1=-2147483648,
    IntervalMax_0=-1.797693135e+308,
    IntervalMax_1=-1.797693135e+308,
    IntervalMin_0=-1.797693135e+308,
    IntervalMin_1=-1.797693135e+308,
    Name_0="Geometry",
    Name_1="Material",
    NumberValue_0=-1.797693135e+308,
    NumberValue_1=-1.797693135e+308,
    OutputHidden_0=False,
    OutputName_0="Scene Object",
    TextValuePersistent_1="OutsideFacade_35",
    TextValueVolatile_1="OutsideFacade_35")

obj_8 = SceneObject(
    Geometry=pipeline_9,
    BooleanValue_0=False,
    BooleanValue_1=False,
    Color_0=RGBA(0, 0, 0, 0),
    Color_1=RGBA(0, 0, 0, 0),
    Hidden_0=False,
    Hidden_1=False,
    IntegerValue_0=-2147483648,
    IntegerValue_1=-2147483648,
    IntervalMax_0=-1.797693135e+308,
    IntervalMax_1=-1.797693135e+308,
    IntervalMin_0=-1.797693135e+308,
    IntervalMin_1=-1.797693135e+308,
    Name_0="Geometry",
    Name_1="Material",
    NumberValue_0=-1.797693135e+308,
    NumberValue_1=-1.797693135e+308,
    OutputHidden_0=False,
    OutputName_0="Scene Object",
    TextValuePersistent_1="OutsideGround_10",
    TextValueVolatile_1="OutsideGround_10")
merge = Merge(Data1=obj_3, Data2=obj_4, Data3=obj_5, Data4=obj_6, Data5=obj_7, Data6=obj_8, Data7=obj_2, Data8=obj)

# ----
# Running Simulation
toggle = BooleanToggle(True)
daylight = AnnualDaylight(
    Name="tiling_ab2",
    Grids=grid,
    Objects=merge,
    RhinoScene=False,
    Run=toggle,
    BooleanValue_0=False,
    BooleanValue_1=False,
    BooleanValue_10=False,
    BooleanValue_11=True,
    BooleanValue_12=False,
    BooleanValue_13=False,
    BooleanValue_14=False,
    BooleanValue_15=False,
    BooleanValue_16=True,
    BooleanValue_17=False,
    BooleanValue_2=False,
    BooleanValue_3=False,
    BooleanValue_4=False,
    BooleanValue_5=False,
    BooleanValue_6=False,
    BooleanValue_7=False,
    BooleanValue_8=False,
    BooleanValue_9=False,
    Color_0=RGBA(0, 0, 0, 0),
    Color_1=RGBA(0, 0, 0, 0),
    Color_10=RGBA(0, 0, 0, 0),
    Color_11=RGBA(0, 0, 0, 0),
    Color_12=RGBA(0, 0, 0, 0),
    Color_13=RGBA(0, 0, 0, 0),
    Color_14=RGBA(0, 0, 0, 0),
    Color_15=RGBA(0, 0, 0, 0),
    Color_16=RGBA(0, 0, 0, 0),
    Color_17=RGBA(0, 0, 0, 0),
    Color_2=RGBA(0, 0, 0, 0),
    Color_3=RGBA(0, 0, 0, 0)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)  # -> Out, SDA, ASE, LEEDv4, LightingEnergy, OpenPercentage, Windows, Grids, Zones

panel = Panel(daylight.Out)

# ----
# Parsing and Mapping
# Simulation Results to Grid
number_slider = Slider(3000, range=0..10000)
grid_v = GridViewer(
    Grid=daylight.Grids,
    UDIMin=Slider(300, range=0..1000),
    UDIMax=number_slider,
    BooleanValue_0=False,
    BooleanValue_1=False,
    BooleanValue_10=False,
    BooleanValue_11=False,
    BooleanValue_12=False,
    BooleanValue_13=False,
    BooleanValue_14=False,
    BooleanValue_15=False,
    BooleanValue_16=False,
    BooleanValue_17=False,
    BooleanValue_18=False,
    BooleanValue_19=False,
    BooleanValue_2=False,
    BooleanValue_20=False,
    BooleanValue_3=False,
    BooleanValue_4=False,
    BooleanValue_5=False,
    BooleanValue_6=False,
    BooleanValue_7=False,
    BooleanValue_8=False,
    BooleanValue_9=False,
    Color_0=RGBA(0, 0, 0, 0),
    Color_1=RGBA(0, 0, 0, 0),
    Color_10=RGBA(0, 0, 0, 0),
    Color_11=RGBA(0, 0, 0, 0),
    Color_12=RGBA(0, 0, 0, 0),
    Color_13=RGBA(0, 0, 0, 0),
    Color_14=RGBA(0, 0, 0, 0),
    Color_15=RGBA(0, 0, 0, 0),
    Color_16=RGBA(0, 0, 0, 0)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)  # -> SDA, ASE, SensorPts, SensorData, UDI

# ----
# Parsing some results and writting them to a text file.
# - please set the directory to a local directory in your computer -
udithreshold = Slider(50, range=0..100)
directory = FilePath("C:\Users\iicpe\Desktop\KhepriNotebook\Facade_Tiling_Optimization\scripts\")
python = GhPythonScript(
    sDA=grid_v.SDA,
    ASE=grid_v.ASE,
    UDI=grid_v.UDI,
    udiThreshold=udithreshold,
    nameFile="results",
    location=directory,
    writeFile=Toggle(True))  # -> out, a; inputs UDI: list, udiThreshold: Int32
# ---------- python: Python ----------
__author__ = "lsantos2"
__version__ = "2020.04.19"

import rhinoscriptsyntax as rs

#Calculating sUDI

def sUDI(UDIval, threshold):
    """
    Given a list of UDI values and a tresholds to UDI
    it computes the area that is above or equal to threshold.
    """
    return round(len([i for i in UDIval if i >= threshold])/len(UDIval) * 100,2) 

def writeDataOnFile(someData, fileName, path):
    """
    Given data as a list, a name for the file, and a local directory
    this function writes a file with the data in different lines.
    """
    aFile= open(str(path) + str(fileName) + ".txt", "w")
    dataAsStr= [str(i)+"\n" for i in someData]
    aFile.writelines(dataAsStr)
    aFile.close()

results= [sDA, ASE, sUDI(UDI, udiThreshold)]

if writeFile:
    writeDataOnFile(results, nameFile, location)
else:
    pass
# ---------- end python ----------
panel_2 = Panel(directory)
